# Grasshopper definition test_model.gh (Grasshopper 0.9.76)
# plug-ins: Karamba, RFEMmemberForces

crosecselect = CrossSectionSelectorKaramba()  # -> CrossSection, Info
crosecrselect = CrossSectionRangeSelectorKaramba(MaximumHeight_cm=-1, MaximumWidth_cm=-1, menu=[dropdown(1), dropdown(1), dropdown(1)])
ln = Line(StartPoint="0,0,0", EndPoint="3,0,0")
pt = Point("3,0,0")
pt_2 = Point("0,0,0")
matselect = MaterialSelectionKaramba(menu=[dropdown(2), dropdown(6)])
supp = SupportKaramba(PosInd=pt_2, menu=[buttons(off, on, on, on, off, on)])
loads = LoadsKaramba(Vector="0,0,-10", LCase=0, mode="Uniform Line", menu=[buttons(on, off, off)])
linetobeam = LineToBeamKaramba(Line=ln, New=True, Remove=True, LimitDistance_m=0.005)  # -> Points, Element, Info
supp_2 = SupportKaramba(PosInd=pt, menu=[buttons(on, on, on, on, off, on)])
item = ListItem(List=crosecrselect, Index=0, Wrap=True)
assemble = AssembleModelKaramba(
    Elem=linetobeam.Element,
    Support=[supp, supp_2],
    Load=loads,
    CrossSection=item,
    Material=matselect,
    LimitDistance_m=0.005)  # -> Model, Info, Mass_kg, CenterOfGravity
tk = TranslateKaramba(Testi=assemble.Model)
analyzethi = AnalyzeThIKaramba(Model=assemble.Model)  # -> CalculatedModel, MaximumDisplacement_m, ResultingForceOfGravity_kN, ElasticEnergy_kNm
modelview = ModelViewKaramba(Model=analyzethi.CalculatedModel, LoadCaseFactorsForLinearSuperposition=1, IndexIncrementOfVisibleLoadcase=0)  # -> Model, DeformedMesh, DeformedAxes, DeformedModel
beamview = BeamViewKaramba(Model=modelview.Model)  # -> Model, MeshesOfRenderedBeams, DeformedBeamAxes, LegendColors, LegendTags
